# Grasshopper definition Collaboration table GH defintion.gh (Grasshopper 0.9.76)
# Copyright: Co-de-iT
# plug-ins: LocalCode, Firefly.X, Kangaroo Components, setFlounderCamera, Firefly.Core

toggle = BooleanToggle(True)
extra_cutout_depth = Slider(0.6, range=0..1.2)
material_thickness = Slider(8, range=0.2..20)
pass_depth = Slider(0.5, range=0.5..20)
cut_depth_pocket = Slider(2.5, range=0.2..20)
cutout_tolerance = Slider(0, range=-0.5..0.5)
plunge_rate = Slider(25, range=6..25)
feed_rate = Slider(10, range=6..80)
tool_diameter = Slider(3, range=0..10)
raster_direction_along_y = BooleanToggle(False)
stepover = Slider(0.8, range=0..1)
camera_height_factor = Slider(2.29, range=1.6..2.3)
_3d_view_rotation_z = Slider(63, range=10..170)
_3d_view_rotation = Slider(0, range=0..360)
# E:\Projects\Toolpaths\BarkBeetle\Networked fabrication\Stream testing\Laser test stream\laserstream_engrave.3dm
panel = Panel("\\FELLES-LASER\Users\Public\Test stream\laserstream_engrave.3dm")
# E:\Projects\Toolpaths\BarkBeetle\Networked fabrication\Stream testing\Laser test stream\laserstream_cut.3dm
panel_2 = Panel("\\FELLES-LASER\Users\Public\Test stream\laserstream_cut.3dm")
pipeline = GeometryPipeline(
    GroupByLayer=False,
    GroupByType=False,
    IncludeHidden=True,
    IncludeLocked=True,
    LayerFilter="Laser engrave",
    NameFilter="*",
    TypeFilter=1073741884)
pipeline_2 = GeometryPipeline(
    GroupByLayer=False,
    GroupByType=False,
    IncludeHidden=True,
    IncludeLocked=True,
    LayerFilter="Laser cut",
    NameFilter="*",
    TypeFilter=4)
cycle_view = Button()
feed_rate_2 = Panel(feed_rate)
plunge_rate_2 = Panel(plunge_rate)
tool_diameter_2 = Panel(tool_diameter)
stepover_2 = Panel(stepover)
cutout_tolerance_2 = Panel(cutout_tolerance)
raster_direction_along_y_2 = Panel(raster_direction_along_y)
material_thickness_2 = Panel(material_thickness)
pass_depth_2 = Panel(pass_depth)
extra_cutout_depth_2 = Panel(extra_cutout_depth)
cut_depth_pocket_2 = Panel(cut_depth_pocket)
pipeline_3 = GeometryPipeline(
    GroupByLayer=False,
    GroupByType=False,
    IncludeHidden=True,
    IncludeLocked=True,
    LayerFilter="CNC line engrave",
    NameFilter="*",
    TypeFilter=4)
pipeline_4 = GeometryPipeline(
    GroupByLayer=False,
    GroupByType=False,
    IncludeHidden=True,
    IncludeLocked=True,
    LayerFilter="CNC pocket",
    NameFilter="*",
    TypeFilter=4)
pipeline_5 = GeometryPipeline(
    GroupByLayer=False,
    GroupByType=False,
    IncludeHidden=True,
    IncludeLocked=True,
    LayerFilter="CNC cut",
    NameFilter="*",
    TypeFilter=4)
button = Button()  # "2D/3D"
swatch = ColourSwatch(SwatchColor=RGB(117, 117, 117))
swatch_2 = ColourSwatch(SwatchColor=RGB(138, 90, 90))

laser_and_cnc_bed = Curve(<curve referenced from the Rhino model>)
sla_3d_print_bed = Curve(<curve referenced from the Rhino model>)
fff_3d_print_bed = Curve(<curve referenced from the Rhino model>)
Y = UnitY(Factor=Slider(63, range=50..450))
Y_2 = UnitY(Factor=Slider(11, range=0..450))
Y_3 = UnitY(Factor=Slider(406, range=350..450))
move = Move(Geometry=fff_3d_print_bed, Motion=Y)  # -> Geometry, Transform
move_2 = Move(Geometry=sla_3d_print_bed, Motion=Y_2)  # -> Geometry, Transform
move_3 = Move(Geometry=laser_and_cnc_bed, Motion=Y_3)  # -> Geometry, Transform
area = Area(Geometry=flatten(move_3.Geometry))  # -> Area, Centroid
dim = Dimensions(Surface=flatten(move_3.Geometry))  # -> UDimension, VDimension
area_2 = Area(Geometry=flatten(move.Geometry))  # -> Area, Centroid
dim_2 = Dimensions(Surface=flatten(move.Geometry))  # -> UDimension, VDimension
area_3 = Area(Geometry=flatten(move_2.Geometry))  # -> Area, Centroid
dim_3 = Dimensions(Surface=flatten(move_2.Geometry))  # -> UDimension, VDimension
multiplication = Multiplication(A=dim.VDimension, B=camera_height_factor)
multiplication_2 = Multiplication(A=dim_3.VDimension, B=camera_height_factor)
multiplication_3 = Multiplication(A=dim_2.VDimension, B=camera_height_factor)
Z = UnitZ(Factor=multiplication)
Z_2 = UnitZ(Factor=multiplication_2)
Z_3 = UnitZ(Factor=multiplication_3)
move_4 = Move(Geometry=area.Centroid, Motion=Z)  # -> Geometry, Transform
move_5 = Move(Geometry=area_3.Centroid, Motion=Z_2)  # -> Geometry, Transform
move_6 = Move(Geometry=area_2.Centroid, Motion=Z_3)  # -> Geometry, Transform

material = CreateMaterial(Diffuse=swatch_2, Specular=RGB(255, 255, 255), Emission=RGB(0, 0, 0), Transparency=0, Shine=0)
material_2 = CreateMaterial(Diffuse=pipeline, Specular=RGB(255, 255, 255), Emission=RGB(0, 0, 0), Transparency=0, Shine=0)
localcodeexport = LocalCodeExport(DestinationFilePath=panel_2, Export=toggle, LayerNames="Laser cut stream", LayerColors=swatch_2, GeometryTree=pipeline_2)
localcodeexport_2 = LocalCodeExport(DestinationFilePath=panel, Export=toggle, LayerNames="Laser engrave stream", LayerColors=swatch, GeometryTree=pipeline)
cnc_line_engrave_curves = Curve(pipeline_3)
cnc_pocket_curves = Curve(pipeline_4)
cnc_cutout_curves = Curve(pipeline_5)
preview = CustomPreview(Geometry=pipeline_2, Shader=material)
preview_2 = CustomPreview(Geometry=swatch, Shader=material_2)
panel_3 = Panel(localcodeexport)
panel_4 = Panel(localcodeexport_2)

number_slider = Slider(25, range=0..100)
timer = Timer(TimerInterval=2, Target=counter)
counter = Counter(Reset=button)
dom = ConstructDomain(DomainStart=Slider(0, range=0..100), DomainEnd=number_slider)
constrain = Constrain(Number=counter, Domain=dom)
panel_5 = Panel(constrain)
subtraction = Subtraction(A=number_slider, B=panel_5)
division = Division(A=subtraction, B=number_slider)
graph = GraphMapper(division, x0=0, x1=1, y0=0, y1=1, container_name="Bezier", cpx=[0, 0.3626089692, 0.494587332, 1], cpy=[0, 0, 1, 1])

number_slider_2 = Slider(25, range=0..100)
timer_2 = Timer(TimerInterval=2, Target=counter_2)
counter_2 = Counter(Reset=cycle_view)
dom_2 = ConstructDomain(DomainStart=Slider(0, range=0..100), DomainEnd=number_slider_2)
constrain_2 = Constrain(Number=counter_2, Domain=dom_2)
panel_6 = Panel(constrain_2)
subtraction_2 = Subtraction(A=number_slider_2, B=panel_6)
division_2 = Division(A=subtraction_2, B=number_slider_2)
graph_2 = GraphMapper(division_2, x0=0, x1=1, y0=0, y1=1, container_name="Bezier", cpx=[0, 0.3626089692, 0.494587332, 1], cpy=[0, 0, 1, 1])

pt = Point(flatten([move_4.Geometry, move_6.Geometry, move_5.Geometry]))
pt_2 = Point(flatten([area.Centroid, area_2.Centroid, area_3.Centroid]))
pline = PolyLine(Vertices=pt_2, Closed=False)
pline_2 = PolyLine(Vertices=pt, Closed=False)
detect = StateDetection(Value=cycle_view, Modulo=3)  # -> CurrentState, Counter
disc = Discontinuity(Curve=pline, Level=2)  # -> Points, Parameters
panel_7 = Panel(detect.Counter)
item = ListItem(List=disc.Parameters, Index=panel_7, Wrap=True)
subtraction_3 = Subtraction(A=item, B=graph_2)
smaller = SmallerThan(FirstNumber=subtraction_3, SecondNumber=Slider(0, range=0..100))  # -> SmallerThan, OrEqualTo
lng = ListLength(List=pt_2)
subtraction_4 = Subtraction(A=lng, B=Slider(1, range=0..1))
multiplication_4 = Multiplication(A=subtraction_3, B=subtraction_4)
neg = Negative(Value=multiplication_4)
filter = StreamFilter(Gate=smaller.SmallerThan, Stream0=subtraction_3, Stream1=neg)
eval = EvaluateCurve(Curve=pline, Parameter=filter)  # -> Point, Tangent, Angle
eval_2 = EvaluateCurve(Curve=pline_2, Parameter=filter)  # -> Point, Tangent, Angle
yz = YZPlane(Origin=eval.Point)
xy = XYPlane(Origin=eval.Point)

curves_for_raster_pocket = Curve(cnc_pocket_curves)
curves_for_cutout = Curve(cnc_cutout_curves)

# ---- group: Filter out open curves
curves_for_raster_pocket_2 = Curve(curves_for_raster_pocket)
cls = Closed(Curve=curves_for_raster_pocket_2)  # -> Closed, Periodic
dispatch = Dispatch(List=curves_for_raster_pocket_2, DispatchPattern=cls.Closed)  # -> ListA, ListB

# ----
xy_2 = XYPlane(Origin=Point(0, 0, 0))
tool_diameter_3 = Panel(tool_diameter_2)
stepover_3 = Panel(stepover_2)
raster_direction_along_y_3 = Panel(raster_direction_along_y_2)
tool_diameter_4 = Panel(tool_diameter_2)
xy_3 = XYPlane(Origin=Point(0, 0, 0))

# ---- group: Filter out open curves
curves_for_cutout_2 = Curve(curves_for_cutout)
cls_2 = Closed(Curve=curves_for_cutout_2)  # -> Closed, Periodic
dispatch_2 = Dispatch(List=curves_for_cutout_2, DispatchPattern=cls_2.Closed)  # -> ListA, ListB

# ----
operation_plane = Plane(xy_2)
raster_direction_bollean = Integer(raster_direction_along_y_3)
operation_plane_2 = Plane(xy_3)
multiplication_5 = Multiplication(A=tool_diameter_3, B="0.5")
multiplication_6 = Multiplication(A=tool_diameter_3, B=stepover_3)
multiplication_7 = Multiplication(A=tool_diameter_4, B="0.5")
tool_radius = Panel(multiplication_5)
stepover_distance = Panel(multiplication_6)
tool_radius_2 = Panel(multiplication_7)
cutout_tolerance_3 = Panel(cutout_tolerance_2)
tool_radius_3 = Panel(tool_radius)
addition = Addition(A=tool_radius_2, B=cutout_tolerance_3)
panel_8 = Panel(graph)
compensated_tool_radius = Panel(addition)

# ---- group: Merge overlapping curves
curves_for_merging_overlap = Curve(dispatch.ListA)
mcx = MultipleCurves(Curves=curves_for_merging_overlap)  # -> Points, IndexA, IndexB, ParamA, ParamB
dcon = DeleteConsecutive(Set=[mcx.IndexA, mcx.IndexB], Wrap=False)  # -> Set, Count
item_2 = ListItem(List=curves_for_merging_overlap, Index=dcon.Set, Wrap=True)
cull_i = CullIndex(List=curves_for_merging_overlap, Indices=dcon.Set, Wrap=True)
runion = RegionUnion(Curves=item_2, Plane=operation_plane)
merged_overlapping_curves = Curve([runion, cull_i])

curves_for_merging_overlap_2 = Curve(dispatch_2.ListA)
mcx_2 = MultipleCurves(Curves=curves_for_merging_overlap_2)  # -> Points, IndexA, IndexB, ParamA, ParamB
dcon_2 = DeleteConsecutive(Set=[mcx_2.IndexA, mcx_2.IndexB], Wrap=False)  # -> Set, Count
item_3 = ListItem(List=curves_for_merging_overlap_2, Index=dcon_2.Set, Wrap=True)
cull_i_2 = CullIndex(List=curves_for_merging_overlap_2, Indices=dcon_2.Set, Wrap=True)
runion_2 = RegionUnion(Curves=item_3, Plane=operation_plane_2)
merged_overlapping_curves_2 = Curve([runion_2, cull_i_2])

# ----
Y_4 = UnitY(Factor=1)

detect_2 = StateDetection(Value=button, Modulo=2)  # -> CurrentState, Counter
panel_9 = Panel(detect_2.Counter)
larger = LargerThan(FirstNumber=panel_9, SecondNumber=Slider(0, range=0..100))  # -> LargerThan, OrEqualTo
subtraction_5 = Subtraction(A=Slider(1, range=0..1), B=graph)
filter_2 = StreamFilter(Gate=larger.LargerThan, Stream0=graph, Stream1=subtraction_5)
Z_4 = UnitZ(Factor=1)
round = Round(Number=filter_2)  # -> Nearest, Floor, Ceiling
multiplication_8 = Multiplication(A=_3d_view_rotation_z, B=filter_2)
filter_3 = StreamFilter(Gate=round.Ceiling, Stream0=Y_4, Stream1=Z_4)
panel_10 = Panel(multiplication_8)

rotate = Rotate(Geometry=eval_2.Point, Angle=degrees(panel_10), Plane=yz)  # -> Geometry, Transform
num = Number(_3d_view_rotation)
rotate_2 = Rotate(Geometry=rotate.Geometry, Angle=degrees(num), Plane=xy)  # -> Geometry, Transform
enable_view_control = BooleanToggle(True)
int = Integer(Slider(35, range=0..100))
syncfloundercamera = SyncFlounderCamera(
    Activate=enable_view_control,
    ViewportName="Fellesverkstedet",
    Location=rotate_2.Geometry,
    Target=eval.Point,
    Lens=int,
    Up=filter_3)

# ---- group: Align curve directions
curves_for_aligned_direction = Curve(merged_overlapping_curves)
graft = GraftTree(Tree=curves_for_aligned_direction, IncludeEmptyLists=True, IncludeNullItems=True)
offset = Offset(Curve=graft, Distance="0.01", Plane=PlaneXY(0, 0, 0), Corners=2)
end = EndPoints(Curve=offset)  # -> Start, End
pshift = ShiftPaths(Data=end.Start, Offset=-1)
incurve = PointInCurve(Point=pshift, Curve=graft)  # -> Relationship, Point
multiplication_9 = Multiplication(A=incurve.Relationship, B="0.5")
round_2 = Round(Number=multiplication_9)  # -> Nearest, Floor, Ceiling
crv = Curve(graft)
int_2 = Integer(round_2.Nearest)
flip = FlipCurve(Curve=crv)  # -> Curve, Flag
weave = Weave(Pattern=int_2, Stream0=flip.Curve, Stream1=crv, NullGaps=False)
pshift_2 = ShiftPaths(Data=weave, Offset=-1)
aligned_curves = Curve(pshift_2)

curves_for_aligned_direction_2 = Curve(merged_overlapping_curves_2)
graft_2 = GraftTree(Tree=curves_for_aligned_direction_2, IncludeEmptyLists=True, IncludeNullItems=True)
offset_2 = Offset(Curve=graft_2, Distance="0.01", Plane=PlaneXY(0, 0, 0), Corners=2)
end_2 = EndPoints(Curve=offset_2)  # -> Start, End
pshift_3 = ShiftPaths(Data=end_2.Start, Offset=-1)
incurve_2 = PointInCurve(Point=pshift_3, Curve=graft_2)  # -> Relationship, Point
multiplication_10 = Multiplication(A=incurve_2.Relationship, B="0.5")
round_3 = Round(Number=multiplication_10)  # -> Nearest, Floor, Ceiling
crv_2 = Curve(graft_2)
int_3 = Integer(round_3.Nearest)
flip_2 = FlipCurve(Curve=crv_2)  # -> Curve, Flag
weave_2 = Weave(Pattern=int_3, Stream0=flip_2.Curve, Stream1=crv_2, NullGaps=False)
pshift_4 = ShiftPaths(Data=weave_2, Offset=-1)
aligned_curves_2 = Curve(pshift_4)

# ---- group: Detect curves inside curves
aligned_curves_3 = Curve(aligned_curves)
graft_3 = GraftTree(Tree=aligned_curves_3, IncludeEmptyLists=True, IncludeNullItems=True)
end_3 = EndPoints(Curve=aligned_curves_3)  # -> Start, End
incurve_3 = PointInCurve(Point=end_3.Start, Curve=graft_3)  # -> Relationship, Point
multiplication_11 = Multiplication(A=incurve_3.Relationship, B="0.5")
round_4 = Round(Number=multiplication_11)  # -> Nearest, Floor, Ceiling
int_4 = Integer(round_4.Floor)
flip_3 = FlipMatrix(Data=int_4)
ma = MassAddition(Input=flip_3)  # -> Result, PartialResults
pshift_5 = ShiftPaths(Data=ma.Result, Offset=-1)
dispatch_3 = Dispatch(List=aligned_curves_3, DispatchPattern=pshift_5)  # -> ListA, ListB
curves_outside = Curve(dispatch_3.ListB)
curves_inside = Curve(dispatch_3.ListA)

aligned_curves_4 = Curve(aligned_curves_2)
graft_4 = GraftTree(Tree=aligned_curves_4, IncludeEmptyLists=True, IncludeNullItems=True)
end_4 = EndPoints(Curve=aligned_curves_4)  # -> Start, End
incurve_4 = PointInCurve(Point=end_4.Start, Curve=graft_4)  # -> Relationship, Point
multiplication_12 = Multiplication(A=incurve_4.Relationship, B="0.5")
round_5 = Round(Number=multiplication_12)  # -> Nearest, Floor, Ceiling
int_5 = Integer(round_5.Floor)
flip_4 = FlipMatrix(Data=int_5)
ma_2 = MassAddition(Input=flip_4)  # -> Result, PartialResults
pshift_6 = ShiftPaths(Data=ma_2.Result, Offset=-1)
dispatch_4 = Dispatch(List=aligned_curves_4, DispatchPattern=pshift_6)  # -> ListA, ListB
curves_outside_2 = Curve(dispatch_4.ListB)
curves_inside_2 = Curve(dispatch_4.ListA)

# ----
curves_for_offset_outwards = Curve(curves_inside)
curves_for_offset_inwards = Curve(curves_outside)
operation_plane_3 = Plane(operation_plane)
curves_for_offset_outwards_2 = Curve(curves_outside_2)
operation_plane_4 = Plane(operation_plane_2)
curves_for_offset_inwards_2 = Curve(curves_inside_2)
neg_2 = Negative(Value=tool_radius_3)
neg_3 = Negative(Value=compensated_tool_radius)
offset_3 = Offset(Curve=curves_for_offset_inwards, Distance=tool_radius_3, Plane=operation_plane_3, Corners=2)
offset_4 = Offset(Curve=curves_for_offset_outwards, Distance=neg_2, Plane=operation_plane_3, Corners=2)
offset_5 = Offset(Curve=curves_for_offset_outwards_2, Distance=neg_3, Plane=operation_plane_4, Corners=2)
pshift_7 = ShiftPaths(Data=offset_4, Offset=-1)
offset_6 = Offset(Curve=curves_for_offset_inwards_2, Distance=compensated_tool_radius, Plane=operation_plane_4, Corners=2)
pshift_8 = ShiftPaths(Data=offset_3, Offset=-1)
pshift_9 = ShiftPaths(Data=offset_6, Offset=-1)
pshift_10 = ShiftPaths(Data=offset_5, Offset=-1)

# ---- group: Merge overlapping inside curves
curves_for_merging_overlap_3 = Curve(pshift_7)
mcx_3 = MultipleCurves(Curves=curves_for_merging_overlap_3)  # -> Points, IndexA, IndexB, ParamA, ParamB
dcon_3 = DeleteConsecutive(Set=[mcx_3.IndexA, mcx_3.IndexB], Wrap=False)  # -> Set, Count
item_4 = ListItem(List=curves_for_merging_overlap_3, Index=dcon_3.Set, Wrap=True)
runion_3 = RegionUnion(Curves=item_4, Plane=operation_plane_3)
cull_i_3 = CullIndex(List=curves_for_merging_overlap_3, Indices=dcon_3.Set, Wrap=True)
merged_overlapping_curves_3 = Curve([runion_3, cull_i_3])

# ----
outside_cutout_curves = Curve(pshift_10)
inside_cutout_curves = Curve(pshift_9)

outside_cutout_curves_2 = Curve(outside_cutout_curves)
inside_cutout_curves_2 = Curve(inside_cutout_curves)
inside_outline_curves = Curve(inside_cutout_curves_2)
flatten = FlattenTree(Tree=outside_cutout_curves_2, Path="{0}")
end_5 = EndPoints(Curve=inside_outline_curves)  # -> Start, End
incurves = PointInCurves(Point=end_5.Start, Curves=flatten)  # -> Relationship, Index, Point
addition_2 = Addition(A=incurves.Index, B="1")
ins = InsertItems(List=flatten, Item=inside_outline_curves, Indices=incurves.Index, Wrap=True)

sorted_inside_and_outside_curves = Curve(ins)
operation_plane_5 = Plane(operation_plane_3)

# ---- group: Detect narrow gaps
graft_5 = GraftTree(Tree=merged_overlapping_curves_3, IncludeEmptyLists=True, IncludeNullItems=True)
ccx = CurveCurve(CurveA=flatten(pshift_8), CurveB=graft_5)  # -> Points, ParamsA, ParamsB
lng_2 = ListLength(List=ccx.ParamsB)
larger_2 = LargerThan(FirstNumber=lng_2, SecondNumber="0")  # -> LargerThan, OrEqualTo
pshift_11 = ShiftPaths(Data=larger_2.LargerThan, Offset=-1)
ma_3 = MassAddition(Input=pshift_11)  # -> Result, PartialResults
pshift_12 = ShiftPaths(Data=ma_3.Result, Offset=-1)
dispatch_5 = Dispatch(List=merged_overlapping_curves_3, DispatchPattern=pshift_12)  # -> ListA, ListB
rdiff = RegionDifference(CurvesA=pshift_8, CurvesB=dispatch_5.ListA, Plane=operation_plane_5)
inside_outline_curves_2 = Curve(dispatch_5.ListB)
fixed_outline_curves = Curve(rdiff)

# ----
curves_for_raster_generation = Curve(fixed_outline_curves)
raster_direction_bollean_2 = Integer(raster_direction_bollean)

oultine_curve = Curve(curves_for_raster_generation)
X = UnitX(Factor=1)
Y_5 = UnitY(Factor=1)
bbox = BoundingBox(Content=oultine_curve, Plane=PlaneXY(0, 0, 0))  # -> Box, Box_2
rev = Reverse(Vector=Y_5)
edges = BrepEdges(Brep=bbox.Box)  # -> Naked, Interior, NonManifold
filter_4 = StreamFilter(Gate=raster_direction_bollean_2, Stream0="2", Stream1="3")
filter_5 = StreamFilter(Gate=raster_direction_bollean_2, Stream0="3", Stream1="2")
filter_6 = StreamFilter(Gate=raster_direction_bollean_2, Stream0=rev, Stream1=X)
item_5 = ListItem(List=edges.Naked, Index=filter_5, Wrap=True)
item_6 = ListItem(List=edges.Naked, Index=filter_4, Wrap=True)
len = Length(Curve=item_5)
stepover_distance_2 = Panel(stepover_distance)
division_3 = Division(A=len, B=stepover_distance_2)
round_6 = Round(Number=division_3)  # -> Nearest, Floor, Ceiling
series = Series(Start=stepover_distance_2, Step=stepover_distance_2, Count=round_6.Floor)
amp = Amplitude(Vector=filter_6, Amplitude=series)
move_7 = Move(Geometry=item_6, Motion=amp)  # -> Geometry, Transform
raster_curves = Curve(move_7.Geometry)

raster_cutoff_safety_factor = Panel("0.05")

# ---- group: Trim raster curves
dispatch_6 = Dispatch(List=flatten(raster_curves), DispatchPattern=[True, False])  # -> ListA, ListB
operation_plane_6 = Plane(operation_plane)
oultine_curve_2 = Curve(curves_for_raster_generation)
flip_5 = FlipCurve(Curve=dispatch_6.ListA)  # -> Curve, Flag
weave_3 = Weave(Pattern=[0, 1], Stream0=flip_5.Curve, Stream1=dispatch_6.ListB, NullGaps=False)
multiplication_13 = Multiplication(A=tool_radius_3, B=raster_cutoff_safety_factor)
raster_curves_2 = Curve(weave_3)
offset_7 = Offset(Curve=oultine_curve_2, Distance=multiplication_13, Plane=operation_plane_6, Corners=1)
trim = TrimWithRegion(Curve=raster_curves_2, Region=offset_7, Plane=operation_plane_6)  # -> Inside, Outside
simplify = SimplifyTree(Tree=trim.Inside, Front=False)
trimmed_raster_curves = Curve(simplify)

# ---- group: Filter short curves
stepover_distance_3 = Panel(stepover_distance_2)
len_2 = Length(Curve=trimmed_raster_curves)
multiplication_14 = Multiplication(A=stepover_distance_3, B="0.8")
smaller_2 = SmallerThan(FirstNumber=len_2, SecondNumber=multiplication_14)  # -> SmallerThan, OrEqualTo
dispatch_7 = Dispatch(List=trimmed_raster_curves, DispatchPattern=smaller_2.SmallerThan)  # -> ListA, ListB
trimmed_and_filtered_raster_curves = Curve(dispatch_7.ListB)

# ---- group: Create line connections
oultine_curve_3 = Curve(oultine_curve_2)
lng_3 = ListLength(List=flatten(oultine_curve_3))
smaller_3 = SmallerThan(FirstNumber=lng_3, SecondNumber="2")  # -> SmallerThan, OrEqualTo
flatten_2 = FlattenTree(Tree=trimmed_and_filtered_raster_curves, Path="{0}")
pshift_13 = ShiftPaths(Data=trimmed_and_filtered_raster_curves, Offset=-1)
filter_7 = StreamFilter(Gate=smaller_3.SmallerThan, Stream0=pshift_13, Stream1=flatten_2)
crv_3 = Curve(filter_7)
shift = ShiftList(List=crv_3, Shift="-1", Wrap=False)
shift_2 = ShiftList(List=crv_3, Shift="1", Wrap=False)
end_6 = EndPoints(Curve=shift)  # -> Start, End
end_7 = EndPoints(Curve=shift_2)  # -> Start, End
ln = Line(StartPoint=end_6.End, EndPoint=end_7.Start)

# ---- group: Filter intersecting curves
line_connections = Curve(ln)
oultine_curve_4 = Curve(oultine_curve_2)
colom = CollisionOneMany(Collider=line_connections, Obstacles=oultine_curve_4)  # -> Collision, Index
dispatch_8 = Dispatch(List=line_connections, DispatchPattern=colom.Collision)  # -> ListA, ListB
connection_lines = Curve(dispatch_8.ListB)

# ---- group: Move cutout toolpaths to cut depths
addition_3 = Addition(A=material_thickness_2, B=extra_cutout_depth_2)
sorted_inside_and_outside_curves_2 = Curve(sorted_inside_and_outside_curves)
pass_depth_3 = Panel(pass_depth_2)
cut_depth_cutout = Panel(addition_3)
graft_6 = GraftTree(Tree=sorted_inside_and_outside_curves_2, IncludeEmptyLists=True, IncludeNullItems=True)
division_4 = Division(A=cut_depth_cutout, B=pass_depth_3)
round_7 = Round(Number=division_4)  # -> Nearest, Floor, Ceiling
division_5 = Division(A=cut_depth_cutout, B=round_7.Ceiling)
actual_pass_depth = Panel(division_5)
series_2 = Series(Start=actual_pass_depth, Step=actual_pass_depth, Count=round_7.Ceiling)
neg_4 = Negative(Value=series_2)
Z_5 = UnitZ(Factor=neg_4)
move_8 = Move(Geometry=graft_6, Motion=Z_5)  # -> Geometry, Transform
flatten_3 = FlattenTree(Tree=move_8.Geometry, Path="{0}")

# ---- group: Move engrave lines to cut depth
cnc_engrave_curves = Curve(cnc_line_engrave_curves)
move_9 = Move(Geometry=graft(cnc_engrave_curves), Motion=Z_5)  # -> Geometry, Transform
flatten_4 = FlattenTree(Tree=move_9.Geometry, Path="{0}")

# ----
item_7 = ListItem(List=flatten_3, Index=Slider(0, range=0..40), Wrap=True)
panel_11 = Panel("""12
6
0""")
crv_4 = Curve([<curve referenced from the Rhino model> x11])
Z_6 = UnitZ(Factor=panel_11)
cutout_toolpaths = Curve(flatten_3)
move_10 = Move(Geometry=graft(crv_4), Motion=Z_6)  # -> Geometry, Transform
crv_5 = Curve()
cnc_engrave_curves_2 = Curve(cnc_engrave_curves)
crv_6 = Curve(cnc_engrave_curves_2)
panel_12 = Panel("12,4")

# ---- group: Trim with inside outline curves
trimmed_and_filtered_raster_curves_2 = Curve(trimmed_and_filtered_raster_curves)
connection_lines_2 = Curve(connection_lines)
inside_outline_curves_3 = Curve(inside_outline_curves_2)
operation_plane_7 = Plane(operation_plane)
neg_5 = Negative(Value=multiplication_13)
offset_8 = Offset(Curve=inside_outline_curves_3, Distance=neg_5, Plane=operation_plane_7, Corners=1)
oultine_curve_5 = Curve(oultine_curve_2)
lng_4 = ListLength(List=flatten(oultine_curve_5))
smaller_4 = SmallerThan(FirstNumber=lng_4, SecondNumber="2")  # -> SmallerThan, OrEqualTo
pshift_14 = ShiftPaths(Data=trimmed_and_filtered_raster_curves_2, Offset=-1)
flatten_5 = FlattenTree(Tree=trimmed_and_filtered_raster_curves_2, Path="{0}")
filter_8 = StreamFilter(Gate=smaller_4.SmallerThan, Stream0=pshift_14, Stream1=flatten_5)
pshift_15 = ShiftPaths(Data=offset_8, Offset=-1)
lng_5 = ListLength(List=flatten(inside_outline_curves_3))
smaller_5 = SmallerThan(FirstNumber=lng_5, SecondNumber="1")  # -> SmallerThan, OrEqualTo
trim_2 = TrimWithRegions(Curve=filter_8, Regions=pshift_15, Plane=operation_plane_6)  # -> Inside, Outside

# ----
filter_9 = StreamFilter(Gate=smaller_5.SmallerThan, Stream0=trim_2.Outside, Stream1=filter_8)

# ---- group: Trim with inside outline curves (continued)
crv_7 = Curve(filter_9)
join = JoinCurves(Curves=flatten([connection_lines_2, crv_7]), Preserve=True)
raster_curves_3 = Curve(join)

# ----
end_8 = EndPoints(Curve=raster_curves_3)  # -> Start, End
cps = ClosestPoints(Point=end_8.End, Cloud=end_8.Start, Count=2)  # -> ClosestPoint, CPIndex, Distance
dist = Distance(PointA=graft(end_8.Start), PointB=cps.ClosestPoint)
equals = Equality(FirstNumber=dist, SecondNumber="0")  # -> Equality, Inequality
dispatch_9 = Dispatch(List=cps.ClosestPoint, DispatchPattern=equals.Equality)  # -> ListA, ListB
item_8 = ListItem(List=dispatch_9.ListB, Index=0, Wrap=True)
ln_2 = Line(StartPoint=item_8, EndPoint=graft(end_8.End))

merge = Merge(Data1=inside_outline_curves_3, Data2=oultine_curve_4)
insied_and_outside_outline_curves = Curve(flatten(merge))
line_connections_2 = Curve(ln_2)
colom_2 = CollisionOneMany(Collider=line_connections_2, Obstacles=insied_and_outside_outline_curves)  # -> Collision, Index
dispatch_10 = Dispatch(List=line_connections_2, DispatchPattern=colom_2.Collision)  # -> ListA, ListB
stepover_distance_4 = Panel(stepover_distance_2)
len_3 = Length(Curve=dispatch_10.ListB)
multiplication_15 = Multiplication(A=stepover_distance_4, B="3")
larger_3 = LargerThan(FirstNumber=len_3, SecondNumber=multiplication_15)  # -> LargerThan, OrEqualTo
dispatch_11 = Dispatch(List=dispatch_10.ListB, DispatchPattern=larger_3.LargerThan)  # -> ListA, ListB
extra_connection_lines = Curve(dispatch_11.ListB)

extra_connection_lines_2 = Curve(extra_connection_lines)
raster_curves_4 = Curve(join)
join_2 = JoinCurves(Curves=flatten([raster_curves_4, extra_connection_lines_2]), Preserve=False)
raster_curves_5 = Curve(join_2)

inside_outline_curves_4 = Curve(inside_outline_curves_2)
raster_curves_6 = Curve(raster_curves_5)
oultine_curve_6 = Curve(curves_for_raster_generation)
flatten_6 = FlattenTree(Tree=oultine_curve_6, Path="{0}")
end_9 = EndPoints(Curve=inside_outline_curves_4)  # -> Start, End
incurves_2 = PointInCurves(Point=end_9.Start, Curves=flatten_6)  # -> Relationship, Index, Point
addition_4 = Addition(A=incurves_2.Index, B="1")
# fix curve order fail when no raster lines
# fix offset from when 1 line becomes more ? (narrow channels)
ins_2 = InsertItems(List=flatten_6, Item=inside_outline_curves_4, Indices=addition_4, Wrap=True)
end_10 = EndPoints(Curve=raster_curves_6)  # -> Start, End
incurves_3 = PointInCurves(Point=end_10.Start, Curves=ins_2)  # -> Relationship, Index, Point
ins_3 = InsertItems(List=ins_2, Item=raster_curves_6, Indices=incurves_3.Index, Wrap=True)
sorted_raster_and_outline_routes = Curve(flatten(ins_3))

# ---- group: Move pocket toolpaths to cut depths
pass_depth_4 = Panel(pass_depth_2)
cut_depth_pocket_3 = Panel(cut_depth_pocket_2)
sorted_raster_and_outline_routes_2 = Curve(sorted_raster_and_outline_routes)
division_6 = Division(A=cut_depth_pocket_3, B=pass_depth_4)
round_8 = Round(Number=division_6)  # -> Nearest, Floor, Ceiling
division_7 = Division(A=cut_depth_pocket_3, B=round_8.Ceiling)
actual_pass_depth_2 = Panel(division_7)
series_3 = Series(Start=actual_pass_depth_2, Step=actual_pass_depth_2, Count=round_8.Ceiling)
neg_6 = Negative(Value=series_3)
Z_7 = UnitZ(Factor=neg_6)

# ----
group = Group(Objects=sorted_raster_and_outline_routes_2)

# ---- group: Move pocket toolpaths to cut depths (continued)
move_11 = Move(Geometry=group, Motion=Z_7)  # -> Geometry, Transform
ungroup = Ungroup(Group=move_11.Geometry)
flatten_7 = FlattenTree(Tree=ungroup, Path="{0}")

# ----
item_9 = ListItem(List=flatten_7, Index=Slider(23, range=0..40), Wrap=True)
pocket_toolpaths = Curve(flatten_7)
merge_2 = Merge(Data1=flatten(flatten_4), Data2=flatten(pocket_toolpaths), Data3=flatten(cutout_toolpaths))
clean = CleanTree(RemoveNulls=True, RemoveInvalid=True, RemoveEmpty=False, Tree=merge_2)
pocket_and_cutout_toolpaths = Curve(clean)

resample_tolerance = Slider(0.02, range=0.02..0.1)
custom_jog_home_x = Slider(700, range=0..1000)
custom_jog_home_y = Slider(200, range=0..1000)
spindle_speed = Slider(18000, range=6000..18000)
use_custom_jog_home = BooleanToggle(True)
safe_z = Slider(6, range=0..20)
feed_rate_3 = Panel(feed_rate_2)
plunge_rate_3 = Panel(plunge_rate_2)
toolpaths = Curve(pocket_and_cutout_toolpaths)
use_spindle = BooleanToggle(True)
use_inches = BooleanToggle(False)
use_inches_boolean = Panel(use_inches)
feed_rate_4 = Number(feed_rate_3)
plunge_rate_4 = Number(plunge_rate_3)
safe_z_height = Number(safe_z)
sample_tolerance_in_mm = Number(resample_tolerance)
spindle_speed_2 = Number(spindle_speed)
spindle_use_bollean = Number(use_spindle)
use_custom_jog_home_2 = Integer(use_custom_jog_home)
temp_home_x = Number(custom_jog_home_x)
temp_home_y = Number(custom_jog_home_y)
filter_10 = StreamFilter(Gate=use_inches_boolean, Stream0="1", Stream1="25.4")
division_8 = Division(A=temp_home_x, B=filter_10)
division_9 = Division(A=temp_home_y, B=filter_10)
division_10 = Division(A=feed_rate_4, B=filter_10)
division_11 = Division(A=plunge_rate_4, B=filter_10)
division_12 = Division(A=safe_z_height, B=filter_10)

toolpaths_2 = Curve(toolpaths)
topoly = CurveToPolyline(Curve=toolpaths_2, ToleranceDistance=sample_tolerance_in_mm, ToleranceAngle=0)  # -> Polyline, Segments
cp = ControlPoints(Curve=topoly.Polyline)  # -> Points, Weights, Knots
rev_2 = ReverseList(List=cp.Points)
safe_z_height_2 = Number(division_12)
item_10 = ListItem(List=cp.Points, Index=0, Wrap=True)
item_11 = ListItem(List=rev_2, Index=0, Wrap=True)
pdecon = Deconstruct(Point=item_10)  # -> XComponent, YComponent, ZComponent
pdecon_2 = Deconstruct(Point=item_11)  # -> XComponent, YComponent, ZComponent
pt_3 = ConstructPoint(XCoordinate=pdecon.XComponent, YCoordinate=pdecon.YComponent, ZCoordinate=safe_z_height_2)
pt_4 = ConstructPoint(XCoordinate=pdecon_2.XComponent, YCoordinate=pdecon_2.YComponent, ZCoordinate=safe_z_height_2)
safe_z_end_point = Point(pt_4)
safe_z_start_point = Point(pt_3)

rev_3 = ReverseList(List=flatten(safe_z_end_point))
cull_i_4 = CullIndex(List=flatten(safe_z_start_point), Indices=0, Wrap=True)
cull_i_5 = CullIndex(List=rev_3, Indices=0, Wrap=True)
rev_4 = ReverseList(List=flatten(cull_i_5))
ln_3 = Line(StartPoint=safe_z_start_point, EndPoint=item_10)
ln_4 = Line(StartPoint=rev_4, EndPoint=cull_i_4)
ln_5 = Line(StartPoint=item_11, EndPoint=safe_z_end_point)
toolpath_preview_line = Curve(topoly.Polyline)
cut_transition_preview_line = Curve(ln_4)
cut_entry_preview_line = Curve(ln_3)
cut_exit_preview_line = Curve(ln_5)
material_3 = CreateMaterial(
    Diffuse=ColourSwatch(SwatchColor=RGB(184, 251, 255)),
    Specular=RGB(255, 255, 255),
    Emission=RGB(0, 0, 0),
    Transparency=0,
    Shine=0)
material_4 = CreateMaterial(
    Diffuse=ColourSwatch(SwatchColor=RGB(99, 74, 16)),
    Specular=RGB(255, 255, 255),
    Emission=RGB(0, 0, 0),
    Transparency=0,
    Shine=0)
material_5 = CreateMaterial(
    Diffuse=ColourSwatch(SwatchColor=RGB(174, 234, 235)),
    Specular=RGB(255, 255, 255),
    Emission=RGB(0, 0, 0),
    Transparency=0,
    Shine=0)
material_6 = CreateMaterial(
    Diffuse=ColourSwatch(SwatchColor=RGB(77, 114, 115)),
    Specular=RGB(255, 255, 255),
    Emission=RGB(0, 0, 0),
    Transparency=0,
    Shine=0)
preview_3 = CustomPreview(Geometry=toolpath_preview_line, Shader=material_3)
preview_4 = CustomPreview(Geometry=cut_exit_preview_line, Shader=material_6)
preview_5 = CustomPreview(Geometry=cut_transition_preview_line, Shader=material_4)
preview_6 = CustomPreview(Geometry=cut_entry_preview_line, Shader=material_5)

# ---- group: Name
panel_13 = Panel("'tablestream")

# ---- group: Set spindle speed
spindle_speed_3 = Number(spindle_speed_2)
int_6 = Integer(spindle_speed_3)
join_3 = TextJoin(Text=["TR,", int_6, ",1"])

# ---- group: Turn off spindle
filter_11 = StreamFilter(Gate=spindle_use_bollean, Stream1="SO,1,0")

# ---- group: Start spindle
filter_12 = StreamFilter(Gate=spindle_use_bollean, Stream1="SO,1,1")
filter_13 = StreamFilter(Gate=spindle_use_bollean, Stream1="PAUSE 1")

# ---- group: Set Feed rate (X Y speed) and plunge rate (Z speed)
feed_rate_5 = Number(division_10)
plunge_rate_5 = Number(division_11)
plunge_rate_6 = Number(plunge_rate_5)
feed_rate_6 = Number(feed_rate_5)
text = Text("MS,")
text_2 = Text(",")
join_4 = TextJoin(Text=[text, feed_rate_6, text_2, plunge_rate_6])

# ---- group: Stream preview SVG for projector
number_slider_3 = Slider(0, range=0..100)
number_slider_4 = Slider(-0.01, range=-0.1..0.1)
sorted_inside_and_outside_curves_3 = Curve([sorted_inside_and_outside_curves_2, crv_5])
sorted_raster_and_outline_routes_3 = Curve(sorted_raster_and_outline_routes_2)
panel_14 = Panel("1279")
pt_5 = ConstructPoint(XCoordinate=Slider(14, range=0..100), YCoordinate=Slider(3, range=-10..10), ZCoordinate=0)
division_13 = Division(A=Slider(300, range=0..1000), B=Slider(263, range=0..1000))
pt_6 = ConstructPoint(XCoordinate=number_slider_3, YCoordinate=number_slider_3, ZCoordinate=0)
cnc_pocket_curves_2 = Curve(cnc_pocket_curves)
cnc_cutout_curves_2 = Curve(cnc_cutout_curves)
vec2pt = Vector2Pt(PointA=pt_6, PointB=pt_5, Unitize=False)  # -> Vector, Length
crv_8 = Curve(cnc_cutout_curves_2)
xy_4 = XYPlane(Origin=pt_6)
crv_9 = Curve([sorted_raster_and_outline_routes_3, sorted_inside_and_outside_curves_3])
crv_10 = Curve(cnc_pocket_curves_2)
scale = Scale(Geometry=crv_8, Center=pt_6, Factor=division_13)  # -> Geometry, Transform
scale_2 = Scale(Geometry=crv_10, Center=pt_6, Factor=division_13)  # -> Geometry, Transform
scale_3 = Scale(Geometry=crv_9, Center=pt_6, Factor=division_13)  # -> Geometry, Transform
move_12 = Move(Geometry=scale_3.Geometry, Motion=vec2pt.Vector)  # -> Geometry, Transform
move_13 = Move(Geometry=scale_2.Geometry, Motion=vec2pt.Vector)  # -> Geometry, Transform
move_14 = Move(Geometry=scale.Geometry, Motion=vec2pt.Vector)  # -> Geometry, Transform
rotate_3 = Rotate(Geometry=move_12.Geometry, Angle=number_slider_4, Plane=xy_4)  # -> Geometry, Transform
rotate_4 = Rotate(Geometry=move_14.Geometry, Angle=number_slider_4, Plane=xy_4)  # -> Geometry, Transform
rotate_5 = Rotate(Geometry=move_13.Geometry, Angle=number_slider_4, Plane=xy_4)  # -> Geometry, Transform
topoly_2 = CurveToPolyline(Curve=rotate_3.Geometry, ToleranceDistance=Slider(0.25, range=0..1), ToleranceAngle=0)  # -> Polyline, Segments
topoly_3 = CurveToPolyline(Curve=rotate_5.Geometry, ToleranceDistance=Slider(0.25, range=0..1), ToleranceAngle=0)  # -> Polyline, Segments
topoly_4 = CurveToPolyline(Curve=rotate_4.Geometry, ToleranceDistance=Slider(0.25, range=0..1), ToleranceAngle=0)  # -> Polyline, Segments
crv_11 = Curve(topoly_2.Polyline)
int_7 = Integer(panel_14)
int_8 = Integer(panel_14)
crv_12 = Curve(topoly_3.Polyline)
int_9 = Integer(panel_14)
crv_13 = Curve(topoly_4.Polyline)
cluster = Cluster_2(
    background_height=int_7,
    polyline=crv_11,
    stroke_color=ColourSwatch(SwatchColor=RGB(184, 251, 255)),
    stroke_width=Slider(0.8, range=0..5))
cluster_2 = Cluster_2(
    background_height=int_8,
    polyline=crv_12,
    stroke_color=ColourSwatch(SwatchColor=RGB(251, 0, 255)),
    stroke_width=Slider(0.8, range=0..5))
cluster_3 = Cluster_2(
    background_height=int_9,
    polyline=crv_13,
    stroke_color=ColourSwatch(SwatchColor=RGB(0, 140, 255)),
    stroke_width=Slider(0.8, range=0..5))
flatten_8 = FlattenTree(Tree=cluster, Path="{0}")
flatten_9 = FlattenTree(Tree=cluster_2, Path="{0}")
flatten_10 = FlattenTree(Tree=cluster_3, Path="{0}")

# ----
scale_4 = Scale(Geometry=crv_6, Center=pt_6, Factor=division_13)  # -> Geometry, Transform
move_15 = Move(Geometry=scale_4.Geometry, Motion=vec2pt.Vector)  # -> Geometry, Transform
rotate_6 = Rotate(Geometry=move_15.Geometry, Angle=number_slider_4, Plane=xy_4)  # -> Geometry, Transform
topoly_5 = CurveToPolyline(Curve=rotate_6.Geometry, ToleranceDistance=Slider(0.25, range=0..1), ToleranceAngle=0)  # -> Polyline, Segments
crv_14 = Curve(topoly_5.Polyline)
int_10 = Integer(panel_14)
cluster_4 = Cluster_2(
    background_height=int_10,
    polyline=crv_14,
    stroke_color=ColourSwatch(SwatchColor=RGB(186, 255, 200)),
    stroke_width=Slider(0.8, range=0..5))
flatten_11 = FlattenTree(Tree=cluster_4, Path="{0}")

# ---- group: Stream preview SVG for projector (continued)
flatten_12 = FlattenTree(Tree=[flatten_8, flatten_9, flatten_10, flatten_11], Path="{0}")
cluster_5 = Cluster(
    background_width="719",
    background_height=panel_14,
    background_color=ColourSwatch(SwatchColor=RGB(0, 0, 0)),
    data=flatten_12)
stream_save_as_svg = Panel(cluster_5)

# ----
use_inches_boolean_2 = Panel(use_inches)
toolpath_points = Point(cp.Points)
filter_14 = StreamFilter(Gate=use_inches_boolean_2, Stream0="1", Stream1="25.4")
pdecon_3 = Deconstruct(Point=toolpath_points)  # -> XComponent, YComponent, ZComponent
lng_6 = ListLength(List=toolpath_points)
division_14 = Division(A=pdecon_3.XComponent, B=filter_14)
division_15 = Division(A=pdecon_3.YComponent, B=filter_14)
division_16 = Division(A=pdecon_3.ZComponent, B=filter_14)
flatten_13 = FlattenTree(Tree=lng_6, Path="{0}")
panel_18 = Panel(division_14)
panel_19 = Panel(division_15)
panel_20 = Panel(division_16)
merge_3 = Merge(Data1=Slider(0, range=0..100), Data2=flatten_13)
filter_15 = StreamFilter(Gate=spindle_use_bollean, Stream1=join_3)
text_3 = Text("J2,")
text_4 = Text(",")
join_5 = TextJoin(Text=[text_3, division_8, text_4, division_9])

# ---- group: Jog to safe Z
safe_z_height_3 = Number(flatten(safe_z_height_2))
text_5 = Text("JZ,")
graft_7 = GraftTree(Tree=safe_z_height_3, IncludeEmptyLists=True, IncludeNullItems=True)
graft_8 = GraftTree(Tree=text_5, IncludeEmptyLists=True, IncludeNullItems=True)
lng_7 = ListLength(List=flatten(merge_3))
join_6 = TextJoin(Text=[graft_8, graft_7])
dup = DuplicateData(Data=join_6, Number=lng_7, Order=True)

# ---- group: Toolpath coordinates
text_6 = Text("M3,")
text_7 = Text(",")
text_8 = Text(",")
dup_2 = DuplicateData(Data=text_8, Number=lng_6, Order=True)
dup_3 = DuplicateData(Data=text_7, Number=lng_6, Order=True)
dup_4 = DuplicateData(Data=text_6, Number=lng_6, Order=True)
simplify_2 = SimplifyTree(Tree=flatten(dup_4), Front=False)
simplify_3 = SimplifyTree(Tree=flatten(panel_18), Front=False)
simplify_4 = SimplifyTree(Tree=flatten(dup_3), Front=False)
simplify_5 = SimplifyTree(Tree=flatten(panel_19), Front=False)
simplify_6 = SimplifyTree(Tree=flatten(dup_2), Front=False)
simplify_7 = SimplifyTree(Tree=flatten(panel_20), Front=False)
graft_9 = GraftTree(Tree=simplify_2, IncludeEmptyLists=True, IncludeNullItems=True)
graft_10 = GraftTree(Tree=simplify_3, IncludeEmptyLists=True, IncludeNullItems=True)
graft_11 = GraftTree(Tree=simplify_4, IncludeEmptyLists=True, IncludeNullItems=True)
graft_12 = GraftTree(Tree=simplify_5, IncludeEmptyLists=True, IncludeNullItems=True)
graft_13 = GraftTree(Tree=simplify_6, IncludeEmptyLists=True, IncludeNullItems=True)
graft_14 = GraftTree(Tree=simplify_7, IncludeEmptyLists=True, IncludeNullItems=True)
join_7 = TextJoin(Text=[graft_9, graft_10, graft_11, graft_12, graft_13, graft_14])
flatten_14 = FlattenTree(Tree=join_7, Path="{0}")

# ---- group: Insert JZ commands
ma_4 = MassAddition(Input=merge_3)  # -> Result, PartialResults
ins_4 = InsertItems(List=flatten_14, Item=dup, Indices=ma_4.PartialResults, Wrap=True)

# ---- group: Jog to startpoints
item_12 = ListItem(List=division_14, Index=0, Wrap=True)
item_13 = ListItem(List=division_15, Index=0, Wrap=True)
lng_8 = ListLength(List=flatten(item_12))
text_9 = Text(",")
text_10 = Text("J2,")
dup_5 = DuplicateData(Data=text_10, Number=lng_8, Order=True)
dup_6 = DuplicateData(Data=text_9, Number=lng_8, Order=True)
simplify_8 = SimplifyTree(Tree=flatten(dup_5), Front=False)
simplify_9 = SimplifyTree(Tree=flatten(item_12), Front=False)
simplify_10 = SimplifyTree(Tree=flatten(dup_6), Front=False)
simplify_11 = SimplifyTree(Tree=flatten(item_13), Front=False)
graft_15 = GraftTree(Tree=simplify_8, IncludeEmptyLists=True, IncludeNullItems=True)
graft_16 = GraftTree(Tree=simplify_9, IncludeEmptyLists=True, IncludeNullItems=True)
graft_17 = GraftTree(Tree=simplify_10, IncludeEmptyLists=True, IncludeNullItems=True)
graft_18 = GraftTree(Tree=simplify_11, IncludeEmptyLists=True, IncludeNullItems=True)
join_8 = TextJoin(Text=[graft_15, graft_16, graft_17, graft_18])
jh = Text("JH")
flatten_15 = FlattenTree(Tree=join_8, Path="{0}")

# ----
filter_16 = StreamFilter(Gate=use_custom_jog_home_2, Stream0=jh, Stream1=flatten(join_5))

# ---- group: Jog to startpoints (continued)
merge_4 = Merge(Data1=flatten_15, Data2=filter_16)

# ---- group: Insert J2 commands
lng_9 = ListLength(List=merge_4)
dup_7 = DuplicateData(Data=Slider(1, range=0..1), Number=lng_9, Order=True)
addition_5 = Addition(A=dup_7, B=merge_3)
ma_5 = MassAddition(Input=addition_5)  # -> Result, PartialResults
ins_5 = InsertItems(List=ins_4, Item=merge_4, Indices=ma_5.PartialResults, Wrap=True)

# ----
flatten_16 = FlattenTree(Tree=ins_5, Path="{0}")
merge_5 = Merge(Data1=panel_13, Data3=filter_15, Data4=filter_12, Data5=filter_13, Data6=join_4, Data7=flatten_16, Data8=filter_11)
panel_21 = Panel(merge_5)
lng_10 = ListLength(List=panel_21)
panel_22 = Panel(lng_10)

# ==== cluster Cluster
background_details = Panel("<svg xmlns=\"http://www.w3.org/2000/svg\" version=\"1.1\" width=\"W\" height=\"H\" style=\"background-color:rgb(C)\">")
background_width = ClusterInput()
rep = ReplaceText(Text=background_details, Find="W", BackgroundWidth=background_width, RecursiveReplace=False)
background_height = ClusterInput()
rep_2 = ReplaceText(Text=rep, Find="H", BackgroundHeight=background_height, RecursiveReplace=False)
background_color = ClusterInput()
rep_3 = ReplaceText(Text=rep_2, Find="C", BackgroundColor=background_color, RecursiveReplace=False)
data = ClusterInput()
data_2 = Data(data)
merge = Merge(Data1=rep_3, Data2=data_2, Data3="</svg>")
svg_composer = ClusterOutput(merge)

# ==== cluster Cluster_2
polyline = ClusterInput()
disc = Discontinuity(Polyline=polyline, Level=1)  # -> Points, Parameters
pdecon = Deconstruct(Point=disc.Points)  # -> XComponent, YComponent, ZComponent
background_height = ClusterInput()
polyline_string = Panel("<polyline points=\"C\" stroke=\"rgb(S)\" stroke-width=\"W\" stroke-dasharray=\"A\" fill=\"none\" />")
subtraction = Subtraction(BackgroundHeight=background_height, B=pdecon.YComponent)
concat = Concatenate(FragmentA=pdecon.XComponent, FragmentB=",", FragmentC=subtraction, FragmentD=" ")
join = TextJoin(Text=concat)
stroke_color = ClusterInput()
rep = ReplaceText(Text=polyline_string, Find="C", Replace=join, RecursiveReplace=False)
stroke_width = ClusterInput()
rep_2 = ReplaceText(Text=rep, Find="S", StrokeColor=stroke_color, RecursiveReplace=False)
rep_3 = ReplaceText(Text=rep_2, Find="W", StrokeWidth=stroke_width, RecursiveReplace=False)
stroke_dasharray = ClusterInput()
rep_4 = ReplaceText(Text=rep_3, Find="A", StrokeDasharray=stroke_dasharray, RecursiveReplace=False)
polyline_svg = ClusterOutput(rep_4)
